# Grasshopper definition Shell Structure - Triangles Definition.gh (Grasshopper 1.0.7)

# ---- group: Bending Height
bend_height = GetInteger(
    Slider(0, range=0..200),
    AtLeast=1,
    AtMost=1,
    Maximum=2147483647,
    Minimum=-2147483648,
    Prompt="0=Curve, >0 Origami Bending ",
    TreeAccess=False)

# ---- group: Parts
parts = GetInteger(
    Slider(16, range=0..20),
    AtLeast=1,
    AtMost=1,
    Maximum=2147483647,
    Minimum=-2147483648,
    Prompt="Number of Subdivisions of the Shell",
    TreeAccess=False)

# ---- group: Struct Thickness
struct_thickness = GetInteger(
    Slider(1, range=0..100),
    AtLeast=1,
    AtMost=1,
    Maximum=2147483647,
    Minimum=-2147483648,
    Prompt="Struct Thickness",
    TreeAccess=False)

# ---- group: Input Curves
curve = Curve([<curve referenced from the Rhino model> x3])
loft_curves = GetGeometry(
    curve,
    AtLeast=2,
    AtMost=4,
    DeleteInput=False,
    Filter=1073741828,
    Prompt="Input curves in the correct order and direction, as in the loft native command",
    TreeAccess=True)

# ----
loft = Loft(Curves=loft_curves, Options={Adjust=False, Closed=False, LoftEnds=0, LoftSimp=0, LoftType=0, Rebuild=10, Refit=0.01})
divide_surface = DivideSurface(Surface=loft, UCount=parts, VCount=parts)  # -> Points, Normals, Parameters
list_length = ListLength(List=divide_surface.Normals)
division = Division(A=list_length, B=Slider(2, range=0..10))
nurbs_curve = NurbsCurve(Vertices=divide_surface.Points, Degree=Slider(2, range=0..10), Periodic=False)  # -> Curve, Length, Domain
list_item = ListItem(List=divide_surface.Normals, Index=division, Wrap=True)
unit_vector = UnitVector(Vector=list_item)
amplitude = Amplitude(Vector=unit_vector, Amplitude=bend_height)
panel = Panel("""0
1""")
flatten_tree = FlattenTree(Tree=amplitude, Path="{0}")
list_length_2 = ListLength(List=flatten_tree)
repeat_data = RepeatData(Data=panel, Length=list_length_2)
multiplication = Multiplication(A=flatten_tree, B=repeat_data)  # -> graft(Result)
move = Move(Geometry=nurbs_curve.Curve, Motion=multiplication)  # -> Geometry, Transform
flatten_tree_2 = FlattenTree(Tree=move.Geometry, Path="{0}")
control_points = ControlPoints(Curve=flatten_tree_2)  # -> simplify(Points), Weights, Knots
polyline = PolyLine(Vertices=control_points.Points, Closed=False)
explode = Explode(Curve=polyline, Recursive=True)  # -> Segments, Vertices
curve_2 = Curve(explode.Segments)
flip_matrix = FlipMatrix(Data=curve_2)
shift_list = ShiftList(List=flip_matrix, Shift=1, Wrap=True)
cull_index = CullIndex(List=shift_list, Indices=-1, Wrap=True)
ruled_surface = RuledSurface(CurveA=flip_matrix, CurveB=cull_index)  # -> simplify(Surface)
number_slider = Slider(1, range=0..1)
mesh_surface = MeshSurface(Surface=ruled_surface, UCount=number_slider, VCount=number_slider, Overhang=True, Equalize=False)
triangulate = Triangulate(Mesh=mesh_surface)  # -> Mesh, Count
face_boundaries = FaceBoundaries(Mesh=triangulate.Mesh)
face_normals = FaceNormals(Mesh=triangulate.Mesh)  # -> Centers, Normals
panel_2 = Panel("""True
False""")
unit_vector_2 = UnitVector(Vector=face_normals.Normals)
dispatch = Dispatch(List=face_boundaries, DispatchPattern=panel_2)  # -> ListA, ListB
amplitude_2 = Amplitude(Vector=unit_vector_2, Amplitude=struct_thickness)
curve_3 = Curve(dispatch.ListB)
extrude = Extrude(Base=face_boundaries, Direction=amplitude_2)
boundary_surfaces = BoundarySurfaces(Edges=curve_3)
merge = Merge(Data1=extrude, Data2=boundary_surfaces)

# ---- group: Brep Output
brep = Brep(merge)

# ----
context_bake = ContextBake(Geometry=brep)
